% Simulink data dictionary BatteryDCDC.sldd

PlntDCDCEff = 98
PlntDCDCVoltInit = 650
PlntBattIdealVolt = 400
PlntBattIdealSoc = 80
PlntDCDCPwrLmt = 120000

Contact = enum(DefaultValue="Open", StorageType="int8")
  Init = 0
  Open = 1
  Close = 2

PlntBattTempInitDegC = 25
PlntBattSocInit = 0.6
PlntBattCntctrClsdRes = 0.0001
PlntBattCntctrOpenCond = 1.0e-8
PlntBattCntctrThresh = 0.9
PlntBattPreChrgRes = 20
PlntBattPreChrgCap = 10000
PlntBattPreChrgCapSerRes = 1.0e-9
PlntBattPreChrgCapParCond = 0
PlntBattBleedRes = 20
PlntBattBalSwtchClsdRes = 0.01
PlntBattBalSwtchOpenCond = 1.0e-8
PlntBattBalSwtchThresh = 0
PlntBattCondArea = 0.0037
PlntBattCondThick = 0.001
PlntBattThermCond = 205
PlntDCDCEffCurrVec = [-500 -1 1 500]
PlntDCDCEffTmpVec = [280 300 320]
PlntDCDCInitTemp = 300
PlntDCDCMaxCurr = 500
PlntDCDCOutVoltDroop = 0.1
PlntDCDCZeroOutPwrLoss = 1
PlntDCDCFltrCap = 100
PlntDCDCFltrRes = 1.0e-6
PlntDCDCLossV = [0 200 400 600 800 1000]

PlntDCDCLossTbl = [100 100 100 100 100
 100 150 200 250 300
 100 200 300 400 500
 100 250 400 550 700
 100 300 500 700 900
 100 350 600 850 1100]

PlntDCDCLossI = [0 25 50 75 100]
PlntDCDCTimeCnst = 0.005
PlntDCDCThermMass = 44.55
PlntBattNumCellSer = 96
PlntBattNumCellPar = 94
PlntBattChrgMax = 3.153
PlntBattTimeCnst = 0.001

PlntBattOpenCirctVolt = [2.90003 2.90003 2.90003 2.90003 2.90003
 2.94341 2.94341 2.94341 2.94341 2.94341
 2.98679 2.98679 2.98679 2.98679 2.98679
 3.04987 3.04987 3.04987 3.04987 3.04987
 3.09433 3.09433 3.09433 3.09433 3.09433
 3.12791 3.12791 3.12791 3.12791 3.12791
 3.16031 3.16031 3.16031 3.16031 3.16031
 3.20369 3.20369 3.20369 3.20369 3.20369
 3.23862 3.23862 3.23862 3.23862 3.23862
 3.26689 3.26689 3.26689 3.26689 3.26689
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 ]

PlntBattVoltSocBpt = [0 0.01 0.02 0.03 0.04 0.05 0.06 0.07 0.08 0.09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 1]
PlntBattTempBpt = [-10 0 25 40 60]

PlntBattIntrnRes = [0.54124 0.47218 0.1741 0.16472 0.13072
 0.60048 0.51942 0.15823 0.09801 0.03241
 0.57827 0.49613 0.14313 0.06257 0.00499
 0.55606 0.47283 0.13285 0.0492 0.00058
 0.53384 0.44953 0.12044 0.03857 0.00058
 0.51163 0.42624 0.10641 0.0337 0.00058
 0.48942 0.40294 0.09605 0.03258 0.00058
 0.46721 0.37965 0.09162 0.03508 0.0103
 0.44499 0.35635 0.08758 0.0376 0.01722
 0.42278 0.33305 0.08349 0.04115 0.02235
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 ]

PlntBattSocBpt = [0 0.01 0.02 0.03 0.04 0.05 0.06 0.07 0.08 0.09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 1]
PlntBattCapInit = 2.88