% Simulink data dictionary Driver.sldd

DriverInitialGear = 0
DriverShiftTime = 0.1
DriverWheelRange = 1.047198
DriverPositionGainR = 0.25
DriverDelayGain = 0.01
DriverFrontCornerStiff = 40000
DriverRearCornerStiff = 40000
DriverTimeConst = 0.1
DriverYawRateGain = 0.2
DriverPositionGainF = 6
DriverAeroRes = 0.5
DriverDrivelineRes = 2.5
DriverPreviewDist = 4
DriverRollRes = 200
DriverTractiveForce = 15000