% Simulink data dictionary ElectricMachine3.sldd

PlntEM3EffTbl = [52 78 80 82 82 80 78 78 76 74 70
 52 78 80 82 82 80 78 78 76 74 70
 52 78 84 86 86 86 86 84 84 82 82
 52 80 86 86 88 88 88 86 86 84 84
 52 80 86 88 88 88 88 88 86 86 86
 52 80 86 88 90 90 90 90 88 88 88
 52 82 88 90 91 91 92 92 92 91 91
 52 82 88 91 91 92 93 93 93 93 93
 52 84 90 92 92 93 93 93 93 93 93
 62 86 91 93 93 93 93 93 93 93 93
 66 86 91 93 93 93 93 93 93 93 93
 70 86 92 93 93 93 93 93 93 93 93
 70 86 92 93 93 93 93 93 93 93 93
 72 86 91 93 93 93 93 93 93 93 93]

PlntEM3ExtSplySerRes = 0
PlntEM3RotDamp = 0.001
PlntEM3RotInertia = 0.01
PlntEM3RotInitSpd = 0
PlntEM3Spd = [0 52.35988 104.7198 149.9996 157.0796 209.4395 261.7994 314.1593 366.5191 418.879 471.2389 523.5988 575.9587 628.3185]
PlntEM3TimeCnst = 0.02
PlntEM3Trq = [200 200 200 200 190.9859 143.2394 114.5916 95.49297 81.85111 71.61972 63.66198 57.29578 52.08707 47.74648]
PlntEM3TrqEff = [0 20 40 60 80 100 120 140 160 180 200]
PlntEM3TrqLossTbl = repmat(0, 14, 11)
PlntEM3SpdEff = [0 52.35988 104.7198 149.9996 157.0796 209.4395 261.7994 314.1593 366.5191 418.879 471.2389 523.5988 575.9587 628.3185]
PlntEM3SpdLoss = [0 52.35988 104.7198 149.9996 157.0796 209.4395 261.7994 314.1593 366.5191 418.879 471.2389 523.5988 575.9587 628.3185]
PlntEM3TrqLoss = [0 20 40 60 80 100 120 140 160 180 200]