% Simulink data dictionary VirtualVehicleTemplate.sldd
% references SiMappedEngine.sldd
% references SiEngine.sldd
% references SiEngineCore.sldd
% references SiEngineCoreV.sldd
% references SiEngineCoreNA.sldd
% references SiDLEngine.sldd
% references SimpleEngine.sldd
% references CiEngineCore.sldd
% references CiMappedEngine.sldd
% references SiEngineController.sldd
% references CiEngineController.sldd
% references BatteryDCDC.sldd
% references Drivetrain.sldd
% references ElectricMachine1.sldd
% references ElectricMachine2.sldd
% references FuelCellElectricSystem.sldd
% references PassVeh.sldd
% references Trailer.sldd
% references HevPxVCU.sldd
% references HevIpsVCU.sldd
% references HevMmVCU.sldd
% references VehicleConfig.sldd
% references Driver.sldd
% references Environment.sldd
% references Scenario.sldd
% references EvVCU.sldd
% references ElectricMachine3.sldd
% references ElectricMachine4.sldd
% references ElectricalCoolingSystem.sldd
% references PassVehMultibody.sldd
% references EngineDynamometer.sldd

ScnFHSteerAmp = 540
PlntSpKCRollCamber = [0 0]
PlntSpKCRollCaster = [0 0]
PlntSpKCRollSteer = [0 0]
PlntSpKCRollStiffArbFrnt = 0
PlntSpKCRollStiffNoArbFrnt = 0
PlntSpKCRollStiffNoTwstRear = 0
VisScopeType = 1
VisXYPlotter = 1
PlntSpKCVrtLdTrnsfr = [0 0 0 0]
CtrlBcuTrlrBrkGain = Simulink.Parameter(0)
PlntEM1TrqLossTbl = repmat(0, 14, 11)

VVCAccelCmd = Simulink.Bus()
  EnblAccelCmd: boolean, Min=0, Max=1, Unit="one"  % Boolean signal used to override driver model accel commands with user specified inputs
  AccelCmd: double, Min=0, Max=1, Unit="one"  % Normalized accelerator input
  AccelHld: boolean, Min=0, Max=1, Unit="one"  % Boolean signal used to hold the current driver model accel output when true
  AccelZero: boolean, Min=0, Max=1, Unit="one"  % Boolean signal used to override driver model accel commands with zero when value is true

VVCDecelCmd = Simulink.Bus()
  EnblDecelCmd: boolean, Min=0, Max=1, Unit="one"  % Boolean signal used to override driver model decel commands with user specified inputs
  DecelCmd: double, Min=0, Max=1, Unit="one"  % Normalized footpedal decelerator or brake input
  DecelHld: boolean, Min=0, Max=1, Unit="one"  % Boolean signal used to hold the current driver model decel output when true
  DecelZero: boolean, Min=0, Max=1, Unit="one"  % Boolean signal used to override driver model decel commands with zero when value is true
  HndBrkCmd: double, Min=0, Max=1, Unit="one"  % Normalized handbrake / park brake input

VVCLightsCmd = Simulink.Bus()
  HighBeamCmd: boolean
  LowBeamCmd: boolean
  BrakeLightCmd: boolean
  ReverseLightCmd: boolean
  LeftSignalCmd: boolean
  RightSignalCmd: boolean
  FrntFogCmd: boolean
  RearFogCmd: boolean
  TailLightCmd: boolean
  HazzardCmd: boolean
  UserCmd: Bus: VVCUser

VVCSteerCmdAng = Simulink.Bus()
  EnblSteerCmd: boolean, Min=0, Max=1, Unit="one"  % Boolean signal used to override driver model steering commands with user specified inputs
  SteerCmd: double, Unit="rad"  % Normalized handwheel input (steering column).
  SteerHld: boolean, Min=0, Max=1, Unit="one"  % Boolean signal used to hold the current driver model steering output when true
  SteerZero: boolean, Min=0, Max=1, Unit="one"  % Boolean signal used to override driver model steering commands with zero when value is true

VVCTransCmd = Simulink.Bus()
  TransModeCmd: int8, Unit="one"  % Used to spec the mode of operation for the transmission (manual, automatic, sport, econ, etc)
  GearCmd: int8, Unit="one"  % Gear input (could be PRNDL or manual gear numbers) depending on mode of TransModeCmd
  UpShiftCmd: boolean, Unit="one"
  DwnShiftCmd: boolean, Unit="one"
  ClutchCmd: double, Min=0, Max=1, Unit="one"  % Normalized footpedal clutch input

VVCUser = Simulink.Bus()
  UserDblCmd1: double
  UserInt8Cmd1: int8
  UserUint8Cmd1: uint8
  UserBoolCmd1: boolean

VVCDrvRef = Simulink.Bus()
  LngRef: double, Unit="m/s"  % Longitudinal reference velocity
  LtrRef: double, Unit="m"
  XRef: double, Unit="m"  % X reference pose
  YRef: double, Unit="m"  % Y reference pose
  PhiRef: double, Unit="rad"  % Confirmation needed on coords and angular range / units (yaw angle or phi for angular reference)
  CurvRef: double, Unit="1/m"  % Reference path curvature
  CurvGradRef: double, Unit="1/m^2"  % reference curvature gradient (as a function of station)

VVCDrvCmd = Simulink.Bus()
  SteerCmd: Bus: VVCSteerCmdAng
  AccelCmd: Bus: VVCAccelCmd
  DecelCmd: Bus: VVCDecelCmd
  TransCmd: Bus: VVCTransCmd
  LightsCmd: Bus: VVCLightsCmd
  UserCmd: Bus: VVCUser
  IgnModeCmd: int8, Unit="one"

VVCEnv = Simulink.Bus()
  BaroPress: double, Min=0, Unit="pascal"
  AmbTemp: double, Min=0, Unit="kelvin"
  Wind: double[3], Unit="m/s"  % Wind veloicty in the global inertial frame
  Grade: double, Min=0, Unit="deg"

VVCGndSTI4w = Simulink.Bus()
  X: double[4], Unit="m"
  Y: double[4], Unit="m"
  Z: double[4], Unit="m"
  lambda_mux: double[4], Min=0, Unit="one"
  lambda_muy: double[4], Min=0, Unit="one"
  VX: double[4], Unit="m/s"
  VY: double[4], Unit="m/s"
  VZ: double[4], Unit="m/s"
  DCM: double[3 3 4]
  OmegaX: double[4], Unit="rad/s"
  OmegaY: double[4], Unit="rad/s"
  OmegaZ: double[4], Unit="rad/s"
  dZdX: double[4], Unit="one"
  dZdY: double[4], Unit="one"

VVCEnvGnd = Simulink.Bus()
  BaroPress: double, Min=0, Unit="pascal"
  AmbTemp: double, Min=0, Unit="kelvin"
  Wind: double[3], Unit="m/s"  % Wind veloicty in the global inertial frame
  Grade: double, Min=0, Unit="deg"
  Gnd: Bus: VVCGndSTI4w

PlntModelChoices = {"ConfiguredVirtualVehiclePlantModel"}

Acc = Simulink.Bus()
  ax: double, Unit="gee"
  ay: double, Unit="gee"
  az: double, Unit="gee"
  xddot: double, Unit="m/s^2"
  yddot: double, Unit="m/s^2"
  zddot: double, Unit="m/s^2"

Ang = Simulink.Bus()
  phi: double, Unit="rad"
  theta: double, Unit="rad"
  psi: double, Unit="rad"

AngAcc = Simulink.Bus()
  pdot: double, Unit="rad/s^2"
  qdot: double, Unit="rad/s^2"
  rdot: double, Unit="rad/s^2"

AngVel = Simulink.Bus()
  p: double, Unit="rad/s"
  q: double, Unit="rad/s"
  r: double, Unit="rad/s"

BdyFrm = Simulink.Bus()
  Cg: Bus: CgB

Body = Simulink.Bus()
  InertFrm: Bus: InertFrm
  BdyFrm: Bus: BdyFrm

CgB = Simulink.Bus()
  Disp: Bus: DispB
  Vel: Bus: VelB
  AngVel: Bus: AngVel
  Acc: Bus: Acc
  AngAcc: Bus: AngAcc

CgI = Simulink.Bus()
  Disp: Bus: DispI
  Vel: Bus: VelI
  Ang: Bus: Ang

DispB = Simulink.Bus()
  x: double, Unit="m"
  y: double, Unit="m"
  z: double, Unit="m"

DispI = Simulink.Bus()
  X: double, Unit="m"
  Y: double, Unit="m"
  Z: double, Unit="m"

VVCVehFdbk = Simulink.Bus()
  Driver: Bus: Driver
  Body: Bus: Body
  Driveline: Bus: Driveline

VelB = Simulink.Bus()
  xdot: double, Unit="m/s"
  ydot: double, Unit="m/s"
  zdot: double, Unit="m/s"

VelI = Simulink.Bus()
  Xdot: double, Unit="m/s"
  Ydot: double, Unit="m/s"
  Zdot: double, Unit="m/s"

InertFrm = Simulink.Bus()
  Cg: Bus: CgI
  Geom: Bus: CgI

Driver = Simulink.Bus()
  SteerFdbk: double, Unit="rad"
  AccelFdbk: double, Unit="one"
  DecelFdbk: double, Unit="one"
  GearFdbk: int8, Unit="one"
  IgnFdbk: int8, Unit="one"

Driveline = Simulink.Bus()
  EngSpd: double, Unit="rpm"
  EMSpd: double, Unit="rpm"
  TransGear: int8, Unit="one"

VVCGndSTI6w = Simulink.Bus()
  X: double[6], Unit="m"
  Y: double[6], Unit="m"
  Z: double[6], Unit="m"
  lambda_mux: double[6], Min=0, Unit="one"
  lambda_muy: double[6], Min=0, Unit="one"
  VX: double[6], Unit="m/s"
  VY: double[6], Unit="m/s"
  VZ: double[6], Unit="m/s"
  DCM: double[3 3 6]
  OmegaX: double[6], Unit="rad/s"
  OmegaY: double[6], Unit="rad/s"
  OmegaZ: double[6], Unit="rad/s"
  dZdX: double[6], Unit="one"
  dZdY: double[6], Unit="one"